# Grasshopper definition cake.gh (Grasshopper 1.0.8)
# plug-ins: treesloth01

brep = Brep(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)
box = Box(brep)
number_slider = Slider(53, range=0..100)
area = Area(Geometry=box)
scale = Scale(Geometry=brep, Center=area, Factor=Slider(0.94, range=0..3))  # -> Geometry, Transform
cir = Circle(Plane=PlaneXY(0, 0, 0), Radius=Slider(15, range=0..100))
vec = VectorXYZ(XComponent=Slider(0, range=0..100), YComponent=Slider(0, range=0..100), ZComponent=0)  # -> Vector, Length
move = Move(Geometry=scale.Geometry, Motion=vec.Vector)  # -> Geometry, Transform
divide = DivideCurve(Curve=cir, Count=Slider(47, range=0..100), Kinks=False)  # -> Points, Tangents, Parameters
xprod = CrossProduct(VectorA=divide.Tangents, VectorB=Vector(0, 0, 1), Unitize=False)  # -> Vector, Length
line = LineSDL(Start=divide.Points, Direction=Vector(0, 0, 1), Length=number_slider)
Z = UnitZ(Factor=number_slider)
multiplication = Multiplication(A=xprod.Vector, B=Slider(5, range=0..10))
extr = Extrude(Base=cir, Direction=Z)
Z_2 = UnitZ(Factor=1)
cap = CapHoles(Brep=extr)
pl = ConstructPlane(Origin=divide.Points, XAxis=Z_2, YAxis=xprod.Vector)
neg = Negative(Value=Slider(78, range=0..100))
neg_2 = Negative(Value=Slider(7.1, range=0..10))
lng = ListLength(List=pl)
extr_2 = Extrude(Base=line, Direction=multiplication)
series = Series(Start=neg, Step=neg_2, Count=lng)
Y = UnitY(Factor=series)
move_2 = Move(Geometry=PlaneXY(0, 0, 0), Motion=Y)  # -> Geometry, Transform
splitmul = SplitBrepMultiple(Brep=simplify(graft(extr_2)), Cutters=move.Geometry)  # -> simplify(Result)
popgeo = PopulateGeometry(Geometry=splitmul, Count=1, Seed=Slider(3, range=0..10))
brepinc = PointInBrep(Brep=move.Geometry, Point=popgeo, Strict=False)
shift = ShiftPaths(Data=brepinc, Offset=-1)
cull = CullPattern(List=splitmul, CullPattern=invert(shift))
group = Group(Geometry=cull)
orient = Orient(Geometry=group, Source=graft(pl), Target=graft(move_2.Geometry))  # -> Geometry, Transform
swatch = ColourSwatch(SwatchColor=RGB(219, 204, 213))
preview = CustomPreview(Geometry=cap, Material=swatch)
preview_2 = CustomPreview(Geometry=orient.Geometry, Material=swatch)

ungroup = Ungroup(Group=group)
vec_2 = Vector(ungroup)
multiplication_2 = Multiplication(A=vec_2, B=Slider(0.6, range=0..1))
extr_3 = Extrude(Base=ungroup, Direction=multiplication_2)
preview_3 = CustomPreview(Geometry=extr_3, Material=swatch)
