# Grasshopper definition ExtendSurface.gh (Grasshopper 1.0.7)

author = CSharpScript()  # -> Output
# ---------- author: C# usings ----------
using System.IO;
using System.Linq;
using System.Data;
using System.Drawing;
using System.Reflection;
using System.Windows.Forms;
using System.Xml;
using System.Xml.Linq;
using System.Runtime.InteropServices;

using Rhino.DocObjects;
using Rhino.Collections;
using GH_IO;
using GH_IO.Serialization;
# ---------- author: C# ----------
    Output = new List<string>(){
        "Leon Brohmann",
        "Computational Designer",
        "leonbrohmann@gmx.de",
        "www.leonbrohmann.de"
        };
# ---------- author: C# additional code ----------
  //Draw all meshes in this method.
  public override void DrawViewportMeshes(IGH_PreviewArgs args)
  {
    Plane plane;
    args.Viewport.GetCameraFrame(out plane);

    Rectangle bounds = args.Viewport.Bounds;

    int width = 320;
    int height = 34;

    int distW = bounds.Width - width - 40;
    int distH = bounds.Height - height - 40;

    Color _color = ColorTranslator.FromHtml("#004187");

    args.Display.Draw2dRectangle(new Rectangle(distW, distH, width, height), Color.White, 0, Color.White);
    args.Display.Draw2dText("LEONBROHMANN.DE", Color.Black, new Point2d(distW + 4, distH + 7), false, 30);
  }
# ---------- end author ----------
panel = Panel(author)

# ----
# Extend Surface - Example B
north = Slider(4, range=0..100)
east = Slider(11, range=0..100)
south = Slider(26, range=0..100)
west = Slider(24, range=0..100)
issmooth = BooleanToggle(False)
srf = Surface(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)
extendsrfc = CSharpScript(srf=srf, north=north, east=east, south=south, west=west, isSmooth=issmooth)  # -> out, A; inputs srf: Surface, north: Double, east: Double, south: Double, west: Double, isSmooth: Boolean
# ---------- extendsrfc: C# ----------
    srf = srf.Extend(IsoStatus.North, north, isSmooth);
    srf = srf.Extend(IsoStatus.East, east, isSmooth);
    srf = srf.Extend(IsoStatus.South, south, isSmooth);
    srf = srf.Extend(IsoStatus.West, west, isSmooth);

    A = srf;
# ---------- end extendsrfc ----------

# ----
# Extend Surface - Example A
extend_dim = Slider(4, range=0..100)
issmooth_2 = BooleanToggle(False)
srf_2 = Surface(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)
extendsrfc_2 = CSharpScript(srf=srf_2, dim=extend_dim, isSmooth=issmooth_2)  # -> out, A; inputs srf: Surface, dim: Double, isSmooth: Boolean
# ---------- extendsrfc_2: C# ----------
    srf = srf.Extend(IsoStatus.North, dim, isSmooth);
    srf = srf.Extend(IsoStatus.East, dim, isSmooth);
    srf = srf.Extend(IsoStatus.South, dim, isSmooth);
    srf = srf.Extend(IsoStatus.West, dim, isSmooth);

    A = srf;
# ---------- end extendsrfc_2 ----------

# ----
# https://www.leonbrohmann.de/2022/07/08/rhino-gh-extend-surface-c-snippet/
panel_2 = Panel("Link")

# ----
# A extend surface component written in c#
panel_3 = Panel("Summary")
